# Grasshopper definition AugmentedBim.gh (Grasshopper 0.9.76)
# plug-ins: Spectacles.GrasshopperExporter, TT Toolbox

pt = Point([<point referenced from the Rhino model> x4])
swatch = ColourSwatch(SwatchColor=RGB(0, 42, 255))
swatch_2 = ColourSwatch(SwatchColor=RGB(255, 0, 0))
line = LineSDL(Start=pt, Direction=Vector(0, 0, 1), Length=Slider(80, range=0..1000))
geo = Geometry([<brep referenced from the Rhino model> x2])
line_2 = LineSDL(Start=pt, Direction=Vector(0, 0, 1), Length=Slider(78, range=0..1000))
end = EndPoints(Curve=line)  # -> Start, End
spectacles_meshlambertmaterial = Spectacles_MeshLambertMaterial(
    Color=[swatch, swatch_2],
    AmbientColor=[swatch, swatch_2],
    EmissiveColor=RGB(0, 0, 0),
    Object_Opacity=Slider(1, range=0..1),
    SmoothEdges=Toggle(False))
mesh = MeshBrep(
    Brep=geo,
    Settings={GridMaxCount=0, GridMinCount=16, JaggedSeams=False, MaxEdgeLength=0, MinEdgeLength=0.0001, MinTolerance=0, Refine=True, RefineAngle=0, RelativeTolerance=0.65, SimplePlanes=True, Tolerance=0})
preview = CustomPreview(Geometry=mesh, Shader=[swatch, swatch_2])
ttsweepnames = TTSweepNames(outputListLength=0, String="W4X13")
panel = Panel("""color
color""")
panel_2 = Panel("""blue
red""")
pline = PolyLine(Vertices=end.End, Closed=True)
explode = Explode(Curve=pline, Recursive=True)  # -> Segments, Vertices
spectacles_mesh = Spectacles_Mesh(
    Mesh=graft(mesh),
    MeshMaterial=graft(spectacles_meshlambertmaterial),
    AttributeNames=graft(panel),
    AttributeValues=graft(panel_2))
subcrv = SubCurve(BaseCurve=explode.Segments, Domain=Slider(78, range=0..100))
dup = DuplicateData(
    Data=[ColourSwatch(SwatchColor=RGB(68, 255, 0)), ColourSwatch(SwatchColor=RGB(0, 136, 255)), ColourSwatch(SwatchColor=RGB(255, 0, 0)), ColourSwatch(SwatchColor=RGB(255, 204, 0))],
    Number=Slider(2, range=0..10),
    Order=True)
spectacles_meshlambertmaterial_2 = Spectacles_MeshLambertMaterial(Color=dup, AmbientColor=dup, EmissiveColor=RGB(0, 0, 0), Object_Opacity=1, SmoothEdges=Toggle(False))
ttsweep = TTSweep(
    OutputMesh=Toggle(True),
    BeamRail=[line_2, subcrv],
    SectionNameOrCurve=ttsweepnames,
    Justification=-1,
    Rotation=0,
    JustificationIndex=4,
    SectionNameIndex=191,
    ShapeTypeIndex=0,
    UnitTypeIndex=0)  # -> BrepsOrMeshes, SectionProfiles

# ---- group: -xzy - hacky, but it is a hackathon!
pt_2 = ConstructPoint(XCoordinate=0, YCoordinate=0, ZCoordinate=0)
X = UnitX(Factor=1)
rad = Radians(Degrees=Slider(-90, range=-90..90))
line_3 = LineSDL(Start=pt_2, Direction=X, Length=1)
rotax = RotateAxis(Geometry=ttsweep.BrepsOrMeshes, Angle=rad, Axis=line_3)  # -> Geometry, Transform
mirror = Mirror(Geometry=rotax.Geometry, Plane=PlaneYZ(0, 0, 0))  # -> Geometry, Transform

# ----
panel_3 = Panel("C:\Users\agarciapuyol\Documents\GitHub\AugmentedBIM\content\trueScale.json")
preview_2 = CustomPreview(Geometry=ttsweep.BrepsOrMeshes, Shader=dup)
spectacles_mesh_2 = Spectacles_Mesh(Mesh=graft(mirror.Geometry), MeshMaterial=graft(spectacles_meshlambertmaterial_2))
spectacles_scenecompiler = Spectacles_SceneCompiler(Write=Button(), FilePath=panel_3, Elements=flatten(spectacles_mesh_2))
