# Grasshopper definition interiorExample2.gh (Grasshopper 0.9.76)
# plug-ins: LunchBox, Weaverbird, Spectacles.GrasshopperExporter

# ---- group: RH_Input
pt = Point(Point(0, 0, 0))

pt_2 = Point(Point(0, 0, 0))

# ----
number_slider = Slider(2.21, range=0..10)

# ---- group: Input
pt_3 = Point(Point(0, 0, 0))

pt_4 = Point(Point(0, 0, 0))

# ---- group: Operation
pt_5 = Point(Point(0, 0, 0))

pt_6 = Point(Point(0, 0, 0))

# ----
mobius = MobiusSurface(
    UDivisions=100,
    VDivisions=100,
    RParameter=4,
    TParameter=0.5,
    Scale=Slider(0.25, range=0..1),
    Domain1=Domain(-3.141592654, 3.141592654),
    Domain2=Domain(-1, 1))
paraboloid = HyperbolicParaboloid(U=100, V=100, a=number_slider, b=number_slider, S=Slider(3.82, range=1..25), D1=Domain(-4, 4), D2=Domain(-4, 4))

# ---- group: Operation
pt_7 = Point(Point(0, 0, 0))

pt_8 = Point(Point(0, 0, 0))

# ----
Z = UnitZ(Factor=Slider(0.53, range=0..1))

# ---- group: Output
pt_9 = Point(Point(0, 0, 0))

pt_10 = Point(Point(0, 0, 0))

# ----
move = Move(Geometry=mobius, Motion=Z)  # -> Geometry, Transform

# ---- group: Visualization
pt_11 = Point(Point(0, 0, 0))

pt_12 = Point(Point(0, 0, 0))

# ----
mesh_uv = MeshSurface(Surface=paraboloid, UCount=Slider(20, range=5..100), VCount=Slider(20, range=5..100), Overhang=True, Equalize=False)
m_continuum = Continuum(G=mesh_uv, T0=0.5, T1=0.5, T2=0.5, T3=0.9, T4=0.5, D=1, C=False)  # -> out, A; inputs G: GeometryBase, I: list, T0: list, T1: list, T2: list, T3: list, T4: list, D: list, clr: list of Color
# ---------- m_continuum: VB ----------
    Component.Params.Input(0).Name = "Mesh or Curve"
    Component.Params.Input(0).Description = "Open or closed mesh or curve"
    Component.Params.Input(1).Name = "Index [Face]"
    Component.Params.Input(1).Description = "An optional integer or list of integers which specify the faces to be modified if the input is a mesh. If no value is supplied then all faces will be modified"
    Component.Params.Input(2).Name = "Bridge Width [Vertex]"
    Component.Params.Input(2).Description = "Evaluated width of the new bridge start from vertex to edge length"
    Component.Params.Input(3).Name = "Bridge Height [Vertex]"
    Component.Params.Input(3).Description = "Evaluated edge height from face to distance offset"
    Component.Params.Input(4).Name = "Face Width [Vertex]"
    Component.Params.Input(4).Description = "Evaluated width of the center of the bridge"
    Component.Params.Input(5).Name = "Bend Bridge[Vertex]"
    Component.Params.Input(5).Description = "Evaluated from bridge height to mesh face"
    Component.Params.Input(6).Name = "Connection Height [Vertex]"
    Component.Params.Input(6).Description = "Evaluated edge height from face to distance offset"
    Component.Params.Input(7).Name = "Distance [Vertex]"
    Component.Params.Input(7).Description = "An optional number or list of numbers for the offset value from the existing face"
    Component.Params.Input(8).Name = "Closed [Vertex]"
    Component.Params.Input(8).Description = "An optional boolean or list of boolean values which if true will close the edge faces"
    Component.Params.Input(9).Name = "Colors [Vertex]"
    Component.Params.Input(9).Description = "(If applied to a mesh a list of colors corresponding to each mesh vertex, if applied to a curve, a list of colors corresponding to each control point plus an additonal color value for the new averaged center"

    Component.Params.Output(1).Name = "Mesh"
    Component.Params.Output(1).Description = "If successful, a valid mesh"

    If g IsNot Nothing Then
      Dim j,k,kk,n,t,v,w,cnt As Integer
      Dim u() As Integer = Nothing
      Dim tint() As Integer = Nothing
      Dim mo As New mesh
      Dim ov,cv As New list(Of Point3d)
      Dim ovc As New list(Of vector3d)
      Dim ofc As New list(Of meshface)
      Dim oc,oca As New list(Of color)

      Dim blnM, blnC As Boolean

      Dim cen As point3d
      Dim vec As Vector3d
      Dim clrB As Boolean
      Dim avgClr,avgClrC As color

      blnM = g.ObjectType = ObjectType.Mesh
      blnC = g.ObjectType = ObjectType.Curve

      'Declare Mesh Variables
      Dim m As New mesh
      Dim mf As Rhino.Geometry.Collections.MeshFaceList = Nothing
      Dim mv As Rhino.Geometry.Collections.MeshVertexList = Nothing
      Dim mtv As Rhino.Geometry.Collections.MeshTopologyVertexList = Nothing
      Dim mn As Rhino.Geometry.Collections.MeshFaceNormalList = Nothing
      Dim mvn As Rhino.Geometry.Collections.MeshVertexNormalList = Nothing
      Dim mc As Rhino.Geometry.Collections.MeshVertexColorList
      Dim mve As Rhino.Geometry.Collections.MeshTopologyEdgeList = Nothing

      'Declare Curve Variables
      Dim crv As curve
      Dim ncrv As nurbsCurve
      Dim npts As rhino.Geometry.Collections.NurbsCurvePointList
      Dim vs() As vector3f

      If (blnM Or blnC) Then

        If blnM Then
          'Start Deconstruct if Mesh
          m = g
          m.Normals.ComputeNormals()
          m.FaceNormals.ComputeFaceNormals()
          mf = m.Faces
          mv = m.Vertices
          mtv = m.TopologyVertices
          mn = m.FaceNormals
          mvn = m.Normals
          mc = m.VertexColors
          mve = m.TopologyEdges

          'Check Mesh Color Status
          If ((m.VertexColors.count() <> 0) Or (clr.count() <> 0)) Then clrB = True
          If ((m.VertexColors.count() = 0) And (clr.count() <> 0)) Then mc.CreateMonotoneMesh(color.LightGray)

          'Populate Vertex/ Color Lists
          oc = mc.ToArray().ToList()
        Else
          'Start Deconstruct if Curve
          crv = g
          ncrv = crv.ToNurbsCurve()
          npts = ncrv.Points
          Dim pline As Polyline = ncrv.Points.ControlPolygon
          Dim cmsh As New mesh
          cmsh.Vertices.AddVertices(pline.ToArray())
          cmsh.faces.addfaces(pline.TriangulateClosedPolyline())
          cmsh.Normals.ComputeNormals()
          cmsh.Normals.UnitizeNormals

          cv = pline.ToArray().ToList()
          If crv.IsClosed() Then cv.RemoveAt(pline.count() - 1)

          v = cv.Count() - 1
          If Not crv.IsClosed() Then v += 1
          u = appendprepend(v)
          w = -1
          vs = cmsh.Normals.ToArray()

          For j = 0 To v Step 1
            vec += vs(u(j))
            ovc.add(New vector3d(vs(u(j))))
            If (clr.count() > 0) Then If j > (clr.count() - 1) Then oc.add(clr.item(clr.count() - 1)) Else oc.add(clr.item(j))
          Next
          vec /= v
          vec.Unitize
          cen = pline.CenterPoint
        End If

        'Check clr input status
        If clr.count() <> 0 Then clrB = True

      End If
      Dim blnT As Boolean = False
      If blnC Then
        If v Mod 2 Then blnT = True
      ElseIf blnM Then
        If m.Faces.QuadCount() > 0 Then blnT = True
      End If

      If blnT Then
        If blnM Then If i.count() > 0 Then cnt = i.count() Else cnt = mf.count() Else cnt = 1
        For n = 0 To cnt - 1 Step 1
          If blnM Then
            If i.count() > 0 Then j = i.item(n) Else j = n

            tint = mf.GetTopologicalVertices(j)
            cen = mf.GetFaceCenter(j)
            vec = mn.item(j)

            If mf(j).isquad() Then v = 3 Else v = 2
            u = appendprepend(v)
            w = ov.count() - 1
          Else
            j = n
          End If
          vec.Unitize()

          t = 10

          Dim avgD As Double
          avgD = 0

          If clrB Then
            Dim tt As Integer
            Dim aR,aG,aB,bR,bG,bB As New Double
            For k = 0 To v Step 1
              If blnM Then tt = mtv.MeshVertexIndices(tint(k))(0) Else tt = k
              aR += oc.item(tt).R
              aG += oc.item(tt).G
              aB += oc.item(tt).B
              If clr.count() > 0 Then
                If tt > (clr.count() - 1) Then tt = clr.count() - 1
                bR += clr.item(tt).R
                bG += clr.item(tt).G
                bB += clr.item(tt).B
              End If
            Next

            If (blnM Or ((clr.count() - 1) <= v)) Then avgClr = avgC(aR, aG, aB, v + 1) Else avgClr = clr.item(clr.count() - 1)
            If (blnM Or ((clr.count() - 1) <= v)) Then avgClrC = avgC(bR, bG, bB, v + 1) Else avgClrC = clr.item(clr.count() - 1)
          End If

          For k = 1 To v + 1  Step 1
            'Keep distance and t values from exceeding list lengths
            Dim p(2),vc(2) As point3d
            Dim tv(2) As Integer
            Dim nk(1) As Boolean
            Dim da(2),ta0(2),ta1(2),ta2(2),ta3(2),ta4(2) As Double
            Dim tc(2) As color

            For kk = 0 To 2 Step 1
              If blnM Then
                tv(kk) = mtv.MeshVertexIndices(tint(u(k + kk - 1)))(0)
                p(kk) = New point3d(mv(tv(kk)))
                vc(kk) = New Vector3d(mvn(tv(kk)))

                If kk < 2 Then nk(kk) = ubound(mve.GetConnectedFaces(mve.GetEdgeIndex(tint(u(k + kk - 1)), tint(u(k + kk))))) < 1
              Else
                tv(kk) = u(k + kk - 1)
                p(kk) = New point3d(cv(tv(kk)))
                vc(kk) = New Vector3d(ovc(tv(kk)))
                If kk < 2 Then nk(kk) = True
              End If

              If tv(kk) > (d.count() - 1) Then da(kk) = d.item(d.count() - 1) Else da(kk) = d.item(tv(kk))
              If tv(kk) > (t0.count() - 1) Then ta0(kk) = t0.item(t0.count() - 1) Else ta0(kk) = t0.item(tv(kk))
              If tv(kk) > (t1.count() - 1) Then ta1(kk) = t1.item(t1.count() - 1) Else ta1(kk) = t1.item(tv(kk))
              If tv(kk) > (t2.count() - 1) Then ta2(kk) = t2.item(t2.count() - 1) Else ta2(kk) = t2.item(tv(kk))
              If tv(kk) > (t3.count() - 1) Then ta3(kk) = t3.item(t3.count() - 1) Else ta3(kk) = t3.item(tv(kk))
              If tv(kk) > (t4.count() - 1) Then ta4(kk) = t4.item(t4.count() - 1) Else ta4(kk) = t4.item(tv(kk))
              If clr.count() > 0 Then If tv(kk) > (clr.count() - 1) Then tc(kk) = clr.item(clr.count() - 1) Else tc(kk) = clr.item(tv(kk))

            Next

            'Define Vertices
            Dim pA(1),pB(1),pC(1),pD,pE(1),pF(1),pG,pH(1) As point3d
            Dim vA(1) As Vector3d
            Dim tvc As Vector3d
            Dim td As Double


            pD = (((p(1) + p(0)) / 2) + ((p(1) + p(2)) / 2)) / 2
            For kk = 0 To 1 Step 1
              td = (da(kk * 2) + da(1)) / 2
              If (k + 1) Mod 2 Then td *= -1
              tvc = (vc(kk * 2) + vc(1)) / 2
              pA(kk) = (p(1) + p(kk * 2)) / 2
              pB(kk) = evalP(p(1), pA(kk), ta0(1))
              pC(kk) = pA(kk) + tvc * (ta4(kk + 0) + ta4(kk + 1)) / 2 * td * (ta1(kk + 0) + ta1(kk + 1)) / 2
              pE(kk) = evalP(pD, pA(kk), (ta0(kk * 2) + ta0(1)) / 2) + New point3d(tvc * td * ta1(1))
            Next
            If (k + 1) Mod 2 Then td = da(1) Else td = -da(1)
            pG = evalP(cen, pD, ta2(1)) + New point3d(vec * td * ta3(1))

            avgD += da(1)

            ov.add(p(1))
            ov.add(pA(0))
            ov.add(pB(0))
            ov.add(pC(0)) '3
            ov.add(pE(0))
            ov.add(pD + tvc * -td * ta1(1))
            ov.add(pB(1))
            ov.add(pC(1)) '7
            ov.add(pE(1))
            ov.add(pG)

            'Define Faces
            ofc.Add(New meshface(w + u(k) * t + 2, w + u(k) * t + 3, w + u(k) * t + 5, w + u(k) * t + 4))
            ofc.Add(New meshface(w + u(k) * t + 3, w + u(k) * t + 1, w + u(k) * t + 6, w + u(k) * t + 5))
            ofc.Add(New meshface(w + u(k) * t + 1, w + u(k) * t + 7, w + u(k) * t + 9, w + u(k) * t + 6))
            ofc.Add(New meshface(w + u(k) * t + 7, w + u(k + 1) * t + 2, w + u(k) * t + 8, w + u(k) * t + 9))

            If k Mod 2 Then
              ofc.Add(New meshface(w + u(k) * t + 6, w + u(k) * t + 9, w + u(k + 1) * t + 10, w + t * (v + 1) + 1))
              ofc.Add(New meshface(w + u(k) * t + 5, w + u(k) * t + 6, w + t * (v + 1) + 1, w + u(k - 1) * t + 10))
            Else
              ofc.Add(New meshface(w + u(k) * t + 6, w + u(k) * t + 9, w + u(k + 1) * t + 10, w + t * (v + 1) + 2))
              ofc.Add(New meshface(w + u(k) * t + 5, w + u(k) * t + 6, w + t * (v + 1) + 2, w + u(k - 1) * t + 10))
            End If

            If c Then
              If nk(0) Then ofc.Add(New meshface(w + u(k) * t + 2, w + u(k) * t + 3, w + u(k - 1) * t + 8))
              If nk(1) Then ofc.Add(New meshface(w + u(k) * t + 7, w + u(k + 1) * t + 2, w + u(k + 1) * t + 4))
            End If

            'Define Vertex Colors
            If clrB Then
              Dim clB As Boolean = (blnC And ((clr.count() - 1) > v))
              Dim tclr(3) As color
              tclr(0) = evalC(oc.item(tv(1)), oc.item(tv(0)), 0.5)
              tclr(1) = evalC(oc.item(tv(1)), oc.item(tv(2)), 0.5)
              tclr(2) = evalC(avgClr, oc.item(tv(1)), 0.5)
              tclr(3) = evalC(avgClr, oc.item(tv(1)), 0.5)

              oca.add(oc.item(tv(1)))
              oca.add(tclr(0))
              oca.add(evalC(oc.item(tv(1)), tclr(0), ta0(1)))
              If clr.count() > 0 Then If ((tv(1) > (clr.count() - 1)) Or (tv(0) > (clr.count() - 1))) Then oca.add(clr.item(clr.count() - 1)) Else oca.add(evalC(clr.item(tv(1)), clr.item(tv(0)), 0.5)) Else oca.add(tclr(0))
              If clr.count() > 0 Then If ((tv(1) > (clr.count() - 1)) Or (tv(0) > (clr.count() - 1))) Then oca.add(clr.item(clr.count() - 1)) Else oca.add(evalC(evalC(avgClrC, clr.item(tv(1)), 0.5), evalC(clr.item(tv(1)), clr.item(tv(0)), 0.5), ta0(1))) Else oca.add(evalC(tclr(2), tclr(0), ta0(1)))
              oca.add(tclr(2))
              oca.add(evalC(oc.item(tv(1)), tclr(1), ta0(1)))
              If clr.count() > 0 Then If ((tv(1) > (clr.count() - 1)) Or (tv(2) > (clr.count() - 1))) Then oca.add(clr.item(clr.count() - 1)) Else oca.add(evalC(clr.item(tv(1)), clr.item(tv(2)), 0.5)) Else oca.add(tclr(1))
              If clr.count() > 0 Then If ((tv(1) > (clr.count() - 1)) Or (tv(2) > (clr.count() - 1))) Then oca.add(clr.item(clr.count() - 1)) Else oca.add(evalC(evalC(avgClrC, clr.item(tv(1)), 0.5), evalC(clr.item(tv(1)), clr.item(tv(2)), 0.5), ta0(1))) Else oca.add(evalC(tclr(2), tclr(1), ta0(1)))
              If clr.count() > 0 Then If ((tv(1) > (clr.count() - 1)) Or (tv(2) > (clr.count() - 1))) Then oca.add(clr.item(clr.count() - 1)) Else oca.add(evalC(avgClrC, evalC(clr.item(tv(1)), clr.item(tv(2)), 0.5), ta2(1))) Else oca.add(evalC(avgClr, tclr(3), ta2(2)))
            End If

          Next
          avgD /= (v + 1)
          ov.add(cen + vec * avgD)
          ov.add(cen + vec * -avgD)
          If clrB Then
            oca.add(avgClr)
            oca.add(avgClr)
          End If
        Next

        mo.Vertices.AddVertices(ov.toarray())
        If clrB Then mo.VertexColors.AppendColors(oca.toarray())
        mo.Faces.AddFaces(ofc.toarray())
        A = mo

      End If

    End If
# ---------- m_continuum: VB additional code ----------
  Private Function appendprepend(ByVal i As Integer)
    Dim srsEnum As IEnumerable(Of Integer) = Enumerable.Range(0, i + 1)
    Dim arrVal As New list(Of Integer)
    arrVal = srsEnum.tolist()
    arrVal.add(0)
    arrVal.insert(0, i)
    Return arrVal.toarray()
  End Function

  Private Function evalP(ByVal op As point3d, ByVal tp As Point3d, ByVal t As Double)

    Return New point3d(op + (tp - op) * t)
  End Function

  Private Function evalC(ByVal oc As color, ByVal tc As color, ByVal t As Double)
    Dim r,g,b As Integer
    r = CInt(CInt(oc.R) + (CInt(tc.R) - CInt(oc.R)) * t)
    g = CInt(CInt(oc.G) + (CInt(tc.G) - CInt(oc.G)) * t)
    b = CInt(CInt(oc.B) + (CInt(tc.B) - CInt(oc.B)) * t)

    If r > 255 Then r = 255 Else If r < 0 Then r = 0
    If g > 255 Then g = 255 Else If g < 0 Then g = 0
    If b > 255 Then b = 255 Else If b < 0 Then b = 0

    Return color.FromArgb(r, g, b)
  End Function

  Private Function avgC(ByVal R As Double, ByVal G As Double, ByVal B As Double, ByVal T As Integer)

    R /= t
    G /= t
    B /= t
    If R > 255 Then R = 255 Else If R < 0 Then R = 0
    If G > 255 Then G = 255 Else If G < 0 Then G = 0
    If B > 255 Then B = 255 Else If B < 0 Then B = 0

    Return color.FromArgb(CInt(R), CInt(G), CInt(B))
  End Function
# ---------- end m_continuum ----------
wbcatmullclark = WeaverbirdsCatmullClarkSubdivision(MeshCurves=m_continuum.A, Level=1, SmoothNakedEdges=1)

# ---- group: -xzy - hacky, but it is a hackathon!
pt_13 = ConstructPoint(XCoordinate=0, YCoordinate=0, ZCoordinate=0)
X = UnitX(Factor=1)
rad = Radians(Degrees=Slider(-90, range=-90..90))
line = LineSDL(Start=pt_13, Direction=X, Length=1)
rotax = RotateAxis(Geometry=wbcatmullclark, Angle=rad, Axis=line)  # -> Geometry, Transform
mirror = Mirror(Geometry=rotax.Geometry, Plane=PlaneYZ(0, 0, 0))  # -> Geometry, Transform

# ----
swatch = ColourSwatch(SwatchColor=RGB(206, 200, 206))
spectacles_meshlambertmaterial = Spectacles_MeshLambertMaterial(Color=swatch, AmbientColor=swatch, EmissiveColor=RGB(0, 0, 0), Object_Opacity=Slider(0.51, range=0..1), SmoothEdges=True)
panel = Panel("C:\Users\bh\Documents\GitHub\AugmentedBIM\content\interior.json")
spectacles_mesh = Spectacles_Mesh(Mesh=simplify(graft(mirror.Geometry)), MeshMaterial=simplify(graft(spectacles_meshlambertmaterial)))
spectacles_scenecompiler = Spectacles_SceneCompiler(Write=Button(), FilePath=panel, Elements=flatten(spectacles_mesh))
rec = DataRecorder(spectacles_scenecompiler, DataLimit=-10, RecordData=True)
panel_2 = Panel(rec)
