# Grasshopper definition mobiusExample.gh (Grasshopper 0.9.76)
# plug-ins: MeshEdit Components, LunchBox, Spectacles.GrasshopperExporter

# ---- group: RH_Input
pt = Point(Point(0, 0, 0))

pt_2 = Point(Point(0, 0, 0))

# ---- group: Input
pt_3 = Point(Point(0, 0, 0))

pt_4 = Point(Point(0, 0, 0))

# ---- group: Operation
pt_5 = Point(Point(0, 0, 0))

pt_6 = Point(Point(0, 0, 0))

# ----
mobius = MobiusSurface(
    UDivisions=100,
    VDivisions=100,
    RParameter=4,
    TParameter=0.5,
    Scale=Slider(0.25, range=0..1),
    Domain1=Domain(-3.141592654, 3.141592654),
    Domain2=Domain(-1, 1))

# ---- group: Operation
pt_7 = Point(Point(0, 0, 0))

pt_8 = Point(Point(0, 0, 0))

# ----
Z = UnitZ(Factor=Slider(0.53, range=0..1))

# ---- group: Output
pt_9 = Point(Point(0, 0, 0))

pt_10 = Point(Point(0, 0, 0))

# ----
move = Move(Geometry=mobius, Motion=Z)  # -> Geometry, Transform

# ---- group: Visualization
pt_11 = Point(Point(0, 0, 0))

pt_12 = Point(Point(0, 0, 0))

# ----
mesh_uv = MeshSurface(Surface=move.Geometry, UCount=Slider(50, range=5..100), VCount=Slider(9, range=5..100), Overhang=True, Equalize=False)
explode = MeshExplode(Mesh=mesh_uv, Interpolate=False)

# ---- group: -xzy - hacky, but it is a hackathon!
pt_13 = ConstructPoint(XCoordinate=0, YCoordinate=0, ZCoordinate=0)
X = UnitX(Factor=1)
rad = Radians(Degrees=Slider(-90, range=-90..90))
line = LineSDL(Start=pt_13, Direction=X, Length=1)
rotax = RotateAxis(Geometry=explode, Angle=rad, Axis=line)  # -> Geometry, Transform
mirror = Mirror(Geometry=rotax.Geometry, Plane=PlaneYZ(0, 0, 0))  # -> Geometry, Transform

# ----
area = MeshArea(Mesh=explode)  # -> Area, Centroid
pdecon = Deconstruct(Point=area.Centroid)  # -> XComponent, YComponent, ZComponent
bnd = Bounds(Numbers=pdecon.ZComponent)
remap = RemapNumbers(Value=pdecon.ZComponent, Source=bnd, Target=Domain(0, 1))  # -> Mapped, Clipped
gradient = Gradient(
    LowerLimit=0,
    UpperLimit=1,
    Parameter=remap.Mapped,
    stops=[0.241: RGB(255, 0, 147), 0.5: RGB(101, 122, 255), 0.797: RGB(0, 255, 255)])
lng = ListLength(List=explode)
series = Series(Start=1, Step=1, Count=lng)
int = Integer(series)
preview = CustomPreview(Geometry=explode, Shader=gradient)
concat = Concatenate(FragmentA="P_", FragmentB=int)
merge = Merge(Data1=simplify(graft(area.Area)), Data2=simplify(graft(gradient)), Data3=simplify(graft(concat)))
spectacles_meshlambertmaterial = Spectacles_MeshLambertMaterial(
    Color=gradient,
    AmbientColor=gradient,
    EmissiveColor=RGB(0, 0, 0),
    Object_Opacity=Slider(0.75, range=0..1),
    SmoothEdges=True)
panel = Panel("""Panel Area
Color
Name""")
panel_2 = Panel("C:\Users\bh\Documents\GitHub\AugmentedBIM\content\mobius.json")
spectacles_mesh = Spectacles_Mesh(
    Mesh=simplify(graft(mirror.Geometry)),
    MeshMaterial=simplify(graft(spectacles_meshlambertmaterial)),
    AttributeNames=panel,
    AttributeValues=merge)
spectacles_scenecompiler = Spectacles_SceneCompiler(Write=Button(), FilePath=panel_2, Elements=flatten(spectacles_mesh))
rec = DataRecorder(spectacles_scenecompiler, DataLimit=-10, RecordData=True)
panel_3 = Panel(rec)
